# Grasshopper definition architecture2FinalTest.gh (Grasshopper 0.9.75)
# plug-ins: Agent

box = DomainBox(Base=PlaneXY(0, 0, 0), X=Domain(-2, 2), Y=Domain(-0.5, 0.5), Z=Domain(0, 0.25))
pemit = PointEmitter(Point=Point(0, 0, 0), ContinuousFlow=True, CreationRate=1, NumberOfAgents=0)
crv = Curve(<curve referenced from the Rhino model>)
crvemit = CurveEmitter(Curve=crv, ContinuousFlow=True, CreationRate=1, NumberOfAgents=0)
boxemit = BoxEmitter(Box=box, ContinuousFlow=True, CreationRate=1, NumberOfAgents=0)
agent = ConstructAgent(Lifespan=30, Mass=1, BodySize=1, MaxSpeed=0.5, MaxForce=0.1, VisionAngle=15, VisionRadius=5, HistoryLength=1)
bouncecontain = BounceContainBehavior()
srfenv = SurfaceEnvironment()
system = System(Agents=agent, Emitters=crvemit)
timer = Timer(TimerInterval=20, Target=[engine, system])
deconstructsystem = DeconstructSystem(System=system)  # -> Agents, AgentCollection
brepenv = BrepEnvironment()
contain = ContainForce(VisionAngle=15, VisionRadiusMutliplier=1)
cohese = CoheseForce(Agent=deconstructsystem.Agents, GetNeighborsInRadius=deconstructsystem.AgentCollection)
engine = Engine(Reset=Toggle(False), System=system)
