# Grasshopper definition architecture2PerformanceTest.gh (Grasshopper 0.9.75)
# plug-ins: Agent

number_slider = Slider(37, range=0..100)
number_slider_2 = Slider(22, range=0..100)
number_slider_3 = Slider(1000, range=0..1000)
pt = ConstructPoint(XCoordinate=Slider(150, range=0..1000), YCoordinate=0, ZCoordinate=0)
dom = ConstructDomain(DomainStart=expr("-x", number_slider), DomainEnd=number_slider)
dom_2 = ConstructDomain(DomainStart=expr("-x", number_slider_2), DomainEnd=number_slider_2)
toggle = BooleanToggle(False)
box = DomainBox(Base=PlaneXY(0, 0, 0), X=dom, Y=dom, Z=dom)
box_2 = DomainBox(Base=pt, X=dom_2, Y=dom_2, Z=dom_2)
agent = Agent(
    Lifespan=Slider(1000, range=0..1000),
    Mass=1,
    BodySize=1,
    MaximumSpeed=0.5,
    MaximumForce=0.1,
    VisionAngle=15,
    VisionRadius=Slider(5, range=0..100),
    LengthOfPositionHistory=1)  # disabled
cohese = CoheseForce(Weight=1, VisionMultiplier=1)  # disabled
boxemit = BoxEmitter(Box=box, ContinuousFlow=toggle, CreationRate=1, NumberOfAgents=number_slider_3)  # disabled
boxemit_2 = BoxEmitter(Box=box, ContinuousFlow=toggle, CreationRate=1, NumberOfAgents=number_slider_3)
agent_2 = Agent(
    Lifespan=30,
    Mass=1,
    BodySize=1,
    MaximumSpeed=0.5,
    MaximumForce=0.1,
    VisionAngle=15,
    VisionRadius=5,
    LengthOfPositionHistory=1)
pemit = PointEmitter(Point=Point(0, 0, 0), ContinuousFlow=toggle, CreationRate=1, NumberOfAgents=Slider(608, range=0..1000))  # disabled
system = AgentSystem(Agents=agent, Emitters=boxemit, Forces=cohese)  # disabled
system_2 = AgentSystem(Agents=agent_2, Emitters=boxemit_2)
cohese_2 = CoheseForce(System1=system_2, System2=system_2, VisionAngle=360, VisionRadius=5)
timer = Timer(TimerInterval=20, Target=[engine_2, engine, agent_2])
toggle_2 = BooleanToggle(True)
engine = Engine(Reset=toggle_2, System=system_2, Forces=cohese_2)
deconstructsystem = DeconstructSystem(System=system_2)
engine_2 = Engine(Reset=toggle_2, Systems=system)  # disabled
deconstructagent = DeconstructAgent(Agent=engine_2)  # -> Position, Velocity, Acceleration, Lifespan, PositionHistory; disabled
swatch = ColourSwatch(SwatchColor=RGB(255, 0, 255))  # disabled
preview = CustomPreview(Geometry=deconstructsystem, Shader=ColourSwatch(SwatchColor=RGB(0, 255, 255)))
preview_2 = CustomPreview(Geometry=deconstructagent.Position, Shader=swatch)  # disabled
