# Grasshopper definition flockingTest.gh (Grasshopper 0.9.75)
# plug-ins: Agent

number_slider = Slider(15, range=0..100)
planesrf = PlaneSurface(Plane=PlaneXY(0, 0, 0), XSize=Domain(-10, 10), YSize=Domain(-10, 10))  # disabled
number_slider_2 = Slider(4, range=0..10)  # disabled
wires = BrepWireframe(Brep=planesrf, Density=-1)  # disabled
box = CenterBox(Base=PlaneXY(0, 0, 0), X=number_slider, Y=number_slider, Z=number_slider)
wires_2 = BrepWireframe(Brep=box, Density=-1)
number_slider_3 = Slider(1.5, range=0..10)  # disabled
particle = ConstructParticle(
    MinimumInitialVelocity=Vector(-0.1, -0.1, -0.1),
    MaximumInitialVelocity=Vector(0.1, 0.1, 0.1),
    Acceleration=Vector(0, 0, 0),
    Lifespan=Slider(289, range=-1..1000),
    Mass=1,
    BodySize=1,
    HistoryLength=1)
aaboxenv = AxisAlignedBoxEnvironment(Box=box)
join = JoinCurves(Curves=wires, Preserve=False)  # disabled
agent = ConstructAgent(Particle=particle, MaxSpeed=0.5, MaxForce=0.1, VisionRadius=5, VisionAngle=360)
boxemit = BoxEmitter(ContinuousFlow=True, CreationRate=1, NumberOfQuelea=0, Box=box)
srfenv = SurfaceEnvironment(Surface=planesrf)  # -> Environment, _2DReferenceSurface; disabled
number_slider_4 = Slider(0.333, range=0..1)  # disabled
system = System(Quelea=agent, Emitters=boxemit, Environment=aaboxenv)  # -> System, Quelea, QueleaNetwork
followpath = FollowPathForce(
    Apply=True,
    Agent=system.Quelea,
    WeightMultiplier=1,
    Curve=join,
    PathRadius=number_slider_3,
    PredictionDistance=number_slider_2,
    PathTargetDistance=number_slider_2)  # -> Force, PredictionLocation, PathPoint; disabled
timer = Timer(TimerInterval=20, Target=[engine, system])  # disabled
contain = ContainForce(Apply=True, Agent=system.Quelea, WeightMultiplier=1, Environment=aaboxenv, VisionRadiusMutliplier=0.2)
panel = Panel(system.QueleaNetwork)
number_slider_5 = Slider(0.2, range=0..1)  # disabled
engine = Engine(Reset=Toggle(False), System=system.System)
neighbors = GetNeighborsInRadius(Agent=system.Quelea, QueleaNetwork=system.QueleaNetwork, VisionRadiusMultiplier=1, VisionAngleMultiplier=1)  # disabled
neighbors_2 = GetNeighborsInRadius(Agent=system.Quelea, QueleaNetwork=system.QueleaNetwork, VisionRadiusMultiplier=number_slider_4, VisionAngleMultiplier=1)  # disabled
departicle = DeconstructParticle(Particle=system.Quelea)  # -> Position, Velocity, Acceleration, Lifespan, SurfacePosition, SurfaceVelocity, SurfaceAcceleration
item = ListItem(List=departicle.Position, Index=0, Wrap=True)  # -> flatten(Item)
pt = Point(departicle.Position)
pt_2 = Point(departicle.SurfacePosition)  # disabled
separate = SeparateForce(Apply=True, Agent=system.Quelea, WeightMultiplier=number_slider_5, GetNeighborsInRadius=neighbors_2)  # disabled
cohese = CoheseForce(Apply=True, Agent=system.Quelea, WeightMultiplier=1, GetNeighborsInRadius=neighbors)  # disabled
c_script = CSharpScript()  # -> Out, A
vdis = VectorDisplay(Anchor=item, Vector=departicle.Velocity)  # disabled
vdis_2 = VectorDisplay(Anchor=pt_2)  # disabled
vdis_3 = VectorDisplay(Anchor=pt_2, Vector=followpath.Force)  # disabled
oct = OcTree(Points=item, Square=False, Group=5)  # -> Boxes, Points
filter = StreamFilter(Gate=0)
wires_3 = BrepWireframe(Brep=oct.Boxes, Density=-1)
