# Grasshopper definition test.gh (Grasshopper 0.9.75)
# plug-ins: Agent

number_slider = Slider(10, range=0..10)
pt = Point(<point referenced from the Rhino model>)
crv = Curve([<curve referenced from the Rhino model> x2])
loft = Loft(Curves=crv, Options={Adjust=False, Closed=False, LoftEnds=0, LoftSimp=0, LoftType=0, Rebuild=10, Refit=0.01})
box = DomainBox(Base=pt, X=number_slider, Y=number_slider, Z=number_slider)
wboxenv = WorldBoxEnvironment(Box=box)
number_slider_2 = Slider(1, range=0..10)
srfenv = SurfaceEnvironment(Surface=loft)
number_slider_3 = Slider(0.05, range=0..0.1)
brepenv = BrepEnvironment(Brep=box)
pt_2 = Point(<point referenced from the Rhino model>)
pemit = PointEmitter(Point=pt_2, ContinuousFlow=True, CreationRate=1, NumberOfAgents=Slider(100, range=0..100))
agent = Agent(
    Lifespan=Slider(100, range=0..1000),
    Mass=1,
    BodySize=Slider(1, range=0..1),
    MaximumSpeed=0.5,
    MaximumForce=Slider(0.01, range=0..0.01),
    VisionAngle=15,
    VisionRadius=5,
    LengthOfPositionHistory=1)
avoidedges = AvoidEdgesForce(Weight=1, VisionMultiplier=Slider(0.2, range=0..1), Environment=srfenv)
bouncecontainbev = BounceContainBehavior(Environment=brepenv)
system = AgentSystem(Agents=agent, Emitters=pemit, Behaviors=bouncecontainbev)
timer = Timer(TimerInterval=20, Target=engine)  # disabled
engine = Engine(Reset=Toggle(False), LiveUpdate=True, Systems=system)
debugdeconstructagent = DebugDeconstructAgent(Agent=engine)  # -> Position, Velocity, Acceleration, Lifespan, RefPosition
lng = ListLength(List=debugdeconstructagent.Position)
amp = Amplitude(Vector=debugdeconstructagent.Velocity, Amplitude=Slider(0.1, range=0..0.1))
pt_3 = Point(debugdeconstructagent.Position)
vdis = VectorDisplay(Anchor=debugdeconstructagent.Position, Vector=amp)
panel = Panel(lng)
