# Grasshopper definition vehicle.gh (Grasshopper 0.9.75)
# plug-ins: Agent

number_slider = Slider(0.15, range=0..1)
X = UnitX(Factor=Slider(0.15, range=0..1))
vec = VectorXYZ(XComponent=expr("-x", number_slider), YComponent=expr("-x", number_slider), ZComponent=0)  # -> Vector, Length
vec_2 = VectorXYZ(XComponent=number_slider, YComponent=number_slider, ZComponent=0)  # -> Vector, Length
vec_3 = VectorXYZ(XComponent=number_slider, YComponent=0, ZComponent=0)  # -> Vector, Length
number_slider_2 = Slider(1, range=0..1)
number_slider_3 = Slider(0.25, range=0..1)
particle = ConstructParticle(
    MinimumInitialVelocity=vec.Vector,
    MaximumInitialVelocity=vec_2.Vector,
    Acceleration=Vector(0, 0, 0),
    Lifespan=Slider(1000, range=0..1000),
    Mass=1,
    BodySize=1,
    HistoryLength=Slider(150, range=0..1000))
pt = Point(<point referenced from the Rhino model>)
pt_2 = Point(<point referenced from the Rhino model>)
pt_3 = Point(<point referenced from the Rhino model>)
agent = ConstructAgent(Particle=particle, MaxSpeed=0.5, MaxForce=Slider(0.01, range=0..0.01), VisionRadius=5, VisionAngle=360)
xy = XYPlane(Origin=Point(0, 0, 0))
vec2pt = Vector2Pt(PointA=pt_3, PointB=pt, Unitize=False)  # -> Vector, Length
ptemit = PointEmitter(ContinuousFlow=True, CreationRate=1, NumberOfQuelea=Slider(15, range=0..100), Point=pt_2)
vehicle = ConstructVehicle(Agent=agent, Orientation=PlaneXY(0, 0, 0), WheelRadius=Slider(2, range=0..100))
vdis = VectorDisplay(Anchor=pt_3, Vector=vec2pt.Vector)
number_slider_4 = Slider(10, range=0..10)
c_script = CSharpScript(position=pt_3, velocity=vec2pt.Vector, bodySize=Slider(1, range=0..10), orientation=xy)  # -> out, A, B, C; inputs position: Point3d, velocity: Vector3d, bodySize: Double, orientation: Plane
# ---------- c_script: C# ----------
    double halfBodySize = bodySize / 2;
    double halfPi = Math.PI / 2;

    Vector3d wheelLeftVec = velocity;
    Vector3d wheelRightVec = velocity;
    wheelLeftVec.Rotate(halfPi, orientation.ZAxis);
    wheelRightVec.Rotate(-halfPi, orientation.ZAxis);
    wheelLeftVec.Unitize();
    wheelRightVec.Unitize();
    wheelLeftVec = Vector3d.Multiply(wheelLeftVec, halfBodySize);
    wheelRightVec = Vector3d.Multiply(wheelRightVec, halfBodySize);
    A = wheelLeftVec;
    B = wheelRightVec;
    double angle = Vector3d.VectorAngle(Vector3d.XAxis, velocity);


    double wheelLeftX = position.X + halfBodySize * Math.Cos(angle - halfPi);
    double wheelLeftY = position.Y + halfBodySize * Math.Sin(angle - halfPi);

    double wheelRightX = position.X + halfBodySize * Math.Cos(angle + halfPi);
    double wheelRightY = position.Y + halfBodySize * Math.Sin(angle + halfPi);
    //A = new Point3d(wheelLeftX, wheelLeftY, 0);
    //B = new Point3d(wheelRightX, wheelRightY, 0);
    C = angle;
# ---------- end c_script ----------
timer = Timer(TimerInterval=20, Target=[engine, system])
system = System(Quelea=vehicle, Emitters=ptemit)
vdis_2 = VectorDisplay(Anchor=pt_3, Vector=c_script.A)
vdis_3 = VectorDisplay(Anchor=pt_3, Vector=c_script.B)
desystem = DeconstructSystem(System=system)  # -> Quelea, QueleaNetwork
engine = Engine(Reset=Toggle(True), System=system)
pt_4 = Point(<point referenced from the Rhino model>)
sph = Sphere(Base=pt_4, Radius=number_slider_4)
dequelea = DeconstructQuelea(Quelea=desystem.Quelea)  # -> Position, Velocity, Acceleration, Lifespan, ReferencePosition
pt_5 = Point(<point referenced from the Rhino model>)
sensept = SensoryPointForce(Apply=True, Vehicle=desystem.Quelea, WeightMultiplier=1, Point=pt_4, Radius=number_slider_4, Crossed=Toggle(True))  # -> Force, SL, SR
sensept_2 = SensoryPointForce(Apply=True, Vehicle=desystem.Quelea, WeightMultiplier=1, Point=pt_5, Radius=number_slider_4, Crossed=Toggle(True))  # -> Force, SL, SR; disabled
panel = Panel(sensept.SL)
intcrv = Interpolate(Vertices=dequelea.Position, Degree=3, Periodic=False, KnotStyle=1)  # -> Curve, Length, Domain
item = ListItem(List=dequelea.Position, Index=0, Wrap=True)  # -> flatten(Item)
panel_2 = Panel(sensept.SR)
neighbors = GetNeighborsInRadius(Agent=desystem.Quelea, QueleaNetwork=desystem.QueleaNetwork, VisionRadius=Slider(2, range=0..10), VisionAngle=360)
vdis_4 = VectorDisplay(Anchor=item, Vector=dequelea.Velocity)
separate = SeparateForce(Apply=True, Agent=desystem.Quelea, WeightMultiplier=Slider(0.62, range=0..1), GetNeighborsInRadius=neighbors)
