# Grasshopper definition wanderTest_20150326.gh (Grasshopper 0.9.75)
# plug-ins: Agent

number_slider = Slider(15, range=0..100)
pt = Point(<point referenced from the Rhino model>)
box = CenterBox(Base=PlaneXY(0, 0, 0), X=number_slider, Y=number_slider, Z=number_slider)
crv = Curve(<curve referenced from the Rhino model>)
wires = BrepWireframe(Brep=box, Density=-1)
boxemit = BoxEmitter(ContinuousFlow=True, CreationRate=1, NumberOfAgents=0, Box=box)
agent = ConstructAgent(Lifespan=Slider(-1, range=-1..1000), Mass=1, BodySize=1, MaxSpeed=0.5, MaxForce=0.1, HistoryLength=1)
ptemit = PointEmitter(ContinuousFlow=True, CreationRate=1, NumberOfAgents=Slider(1, range=0..100), Point=Point(0, 0, 0))
crvemit = CurveEmitter(ContinuousFlow=True, CreationRate=1, NumberOfAgents=0, Curve=crv)
aaboxenv = AxisAlignedBoxEnvironment(Box=box)
system = System(Agents=agent, Emitters=ptemit)
deconstructsystem = DeconstructSystem(System=system)  # -> Agents, AgentCollection
contain = ContainForce(
    Agent=deconstructsystem.Agents,
    Apply=True,
    WeightMultiplier=Slider(0.25, range=0..1),
    Environment=aaboxenv,
    VisionRadius=Slider(1.5, range=0..10))
timer = Timer(TimerInterval=20, Target=[engine, system])
deconstructagent = DeconstructAgent(Agent=deconstructsystem.Agents)  # -> Position, Velocity, Acceleration, Lifespan, ReferencePosition
engine = Engine(Reset=Toggle(False), System=system)
c_script = CSharpScript(position=deconstructagent.Position, velocity=deconstructagent.Velocity, radius=Slider(0.5, range=0..10))  # -> out, A; inputs position: Point3d, velocity: Vector3d, radius: Double
# ---------- c_script: C# ----------
    Transform xform = Transform.Translation(velocity);
    Point3d pt = position;
    pt.Transform(xform);
    Sphere sphere = new Sphere(pt, radius);
    A = sphere;
    Random random = new Random();
# ---------- end c_script ----------
